# Dynamo graph Attaching foreign levels to levels in your revit file.dyn "Attaching foreign lavels to levels in your revit file" (Dynamo 3.6.1.9895)

string = StringInput("L2")
categories = Categories("OST_Levels")
all_elements_of_category = ElementsOfCategory(Category=categories)
name = Element.Name(element=all_elements_of_category)
string_2 = StringInput("L1")
list_create = List.Create(item0=string_2)
contains = List.Contains(list=name, item=list_create, lacing=Longest)
filterByBoolMask = List.FilterByBoolMask(list=all_elements_of_category, mask=contains)
watch = Watch(filterByBoolMask.out)

# group: Elements on S1 and S2
all_elements_at_level = ElementsAtLevel(Level=filterByBoolMask.out)

# group: Elements in names on S1 and S2
name_2 = Element.Name(element=all_elements_at_level)

flatten = List.Flatten(list=all_elements_at_level)

# group: From list
string_3 = StringInput("S1")
list_create_2 = List.Create(item0=string_3)

contains_2 = List.Contains(list=flatten, item=list_create_2, lacing=Longest)
boolean = BoolSelector(true)
eq = contains_2 == boolean
filterByBoolMask_2 = List.FilterByBoolMask(list=flatten, mask=eq)
string_4 = StringInput("Base Constraint")
number = DoubleInput(0)
getItemAtIndex = List.GetItemAtIndex(list=filterByBoolMask.in, index=number, lacing=Longest)
setParameterByName = Element.SetParameterByName(element=filterByBoolMask_2.out, parameterName=string_4, value=getItemAtIndex, lacing=Longest)
all_elements_at_level_2 = ElementsAtLevel(Level=filterByBoolMask.in)
