# Dynamo graph Duplicate Mark Finder.dyn (Dynamo 3.6.1.9895)

# group: Description of script:
# note: Script Name: Duplicate Mark Finder
# Category: QC - Quality Control
# Author: Catrqu
# Date: 16-05-2026
# Version: 1.0
# Description:
# This script scans all doors in the active Revit project and identifies any doors that share the same Mark parameter value. In large or complex projects duplicate marks are difficult to spot manually and can cause errors in schedules, tags and construction documents.
# How to use:
# 	1.	Open script in Dynamo Player or Dynamo
# 	2.	Run the script
# 	3.	Check the Output group for the list of duplicate Mark values
# 	4.	Go into Revit and manually fix the flagged doors
# Input: All doors in the active Revit project
# Output: A list of Mark values that appear more than once
# Notes:
# 	•	Script is currently set up for Doors only
# 	•	Can be adapted for Windows, Rooms or any other category by changing the Category input node
# 	•	Script only reports duplicates — it does not change anything in your model

# group: Selecting all doors in project
categories = Categories("OST_Doors")
all_elements_of_category = ElementsOfCategory(Category=categories)

# group: Finding every Marks value for every door
string = StringInput("Mark")
getParameterValueByName = Element.GetParameterValueByName(element=all_elements_of_category, parameterName=string)

# group: Creating grouplist and finding unique values
groupByKey = List.GroupByKey(list=all_elements_of_category, keys=getParameterValueByName)

# group: Coutning amount in every group
count = List.Count()  # unwired: list
map = List.Map(list=groupByKey.groups, function=count)

# group: Which ones are > 1
code_block = CodeBlock(x=map) { x>1; }

# group: List of duplicates
filterByBoolMask = List.FilterByBoolMask(list=groupByKey.groups, mask=code_block)
flatten = List.Flatten(list=filterByBoolMask.in)

string_2 = StringInput("Mark")

# group: List of duplicates - shown as value names
getParameterValueByName_2 = Element.GetParameterValueByName(element=flatten, parameterName=string_2)
